# Grasshopper definition AI_Tools.gh (Grasshopper 1.0.8)
# plug-ins: RhinoCodePluginGH

panel = Panel("sk-634DCZNUzA6IJ8KgcSOia5w1ylULijc2gfVKLHoXavT3BlbkFJ3DK0ZBfVaxBBXJ0B9-lMIBmhNvR3YdAq0lKqRYvfYA")
file_path = FilePath("/Users/jorgemuyo/Desktop/Captura de pantalla 2024-10-22 a les 10.42.07.png")
image_to_prompt = Python3Script(x=panel)  # -> out, a
# ---------- image_to_prompt: Python ----------
from openai import OpenAI
import base64

# r: openai

def encode_image(image_path):
    with open(image_path, 'rb') as image_file:
        return base64.b64encode(image_file.read()).decode('utf-8')

api_key = x
image_path = y

client = OpenAI(api_key=api_key)

base64_image = encode_image(image_path)

response = client.chat.completions.create(
    model='gpt-4o-mini',
    messages=[
        {
            'role': 'user',
            'content': [
                {
                    'type': 'text',
                    'text': 'Describe an object that can be modeled in CAD with simple operations, being as explicit as possible, using meassures if possible and focusing on single, self-contained items rather than assemblies. Try to make descriptions as operations in a cad software. Try not to build super long prompts.'
                },
                {
                    'type': 'image_url',
                    'image_url': {
                        'url': f'data:image/png;base64,{base64_image}'
                    },
                }
            ],
        },
    ],
    max_tokens=300,
)

# print('Completion Tokens:', response.usage.completion_tokens)
# print('Prompt Tokens:', response.usage.prompt_tokens)
# print('Total Tokens:', response.usage.total_tokens)

a = response.choices[0].message.content
print(a)
# ---------- end image_to_prompt ----------

# ----
# PROMPT WRITING TIPS:
# 	•	Describe an object that can be represented in geometric shapes, not nebulous concepts such as "a tiger" or "the universe", unless you're just curious what it does with that 😏
# 	•	Be as explicit as possible. For example, if you want a plate with 4 holes, say where you want the holes placed and how big of a diameter each should have
# 	•	ML models are better at describing single objects than assemblies for now
panel_2 = Panel("bd6b055b-416b-442b-a6c3-82435c74c684")
file_path_2 = FilePath("/Users/jorgemuyo/Desktop/STUFF/AI_3D_Models_Grasshopper/")
text_to_cad = Python3Script(api=panel_2, path=file_path_2, prompt="tall LEGO module 2*2", generate=Toggle(False))  # -> out, a, output_file_path; inputs generate: Boolean
# ---------- text_to_cad: Python ----------
#! python 3
# r: kittycad
# requirements: kittycad

import time
import os
import rhinoscriptsyntax as rs
import Rhino
import shutil
import scriptcontext as sc
from datetime import datetime

from kittycad.api.ml import create_text_to_cad, get_text_to_cad_model_for_user
from kittycad.client import Client
from kittycad.models.api_call_status import ApiCallStatus
from kittycad.models.file_export_format import FileExportFormat
from kittycad.models.text_to_cad_create_body import TextToCadCreateBody

# API key
API_KEY = api
client = Client(token=API_KEY)

# Output directory
output_dir = path

# Ensure directory exists
os.makedirs(output_dir, exist_ok=True)

# 'a' to determine the output format (Delete this option when I have time)
a = 2  # Change this value to 1, 2, or 3 to get .stl, .step, or .obj. Better leave it as step. it has way better topology

# 'run_code' controls whether the script should run or not
run_code = generate 

if run_code:
    # Determine the output format based on 'a'
    if a == 1:
        output_format = FileExportFormat.STL
        file_extension = "stl"
    elif a == 2:
        output_format = FileExportFormat.STEP
        file_extension = "step"
    elif a == 3:
        output_format = FileExportFormat.OBJ
        file_extension = "obj"
    else:
        raise ValueError("Invalid value for 'a'. Choose 1 for .stl, 2 for .step, or 3 for .obj.")

    # Prompt to generate a 3D mode
    response = create_text_to_cad.sync(
        client=client,
        output_format=output_format,
        body=TextToCadCreateBody(
            prompt=prompt,
        ),
    )

    # Check if the task is complete
    while response.completed_at is None:
        time.sleep(5)

        response = get_text_to_cad_model_for_user.sync(
            client=client,
            id=response.id,
        )

    if response.status == ApiCallStatus.FAILED:
        print(f"Text-to-CAD failed: {response.error}")

    elif response.status == ApiCallStatus.COMPLETED:
        # Print out generated files
        print(f"Text-to-CAD completed and returned {len(response.outputs)} files:")
        for name in response.outputs:
            print(f"  * {name}")

        # Retrieve the binary data of the output file
        final_result = response.outputs[f"source.{file_extension}"]
        
        # Define the output file path
        output_file_path = os.path.join(output_dir, f"text-to-cad-output.{file_extension}")
        
        # Write the raw bytes directly to the output file
        with open(output_file_path, "wb") as output_file:
            output_file.write(final_result)
            print(f"Saved to {output_file_path}")
else:
    print("Script execution skipped as run_code False.")


def import_step_file(step_file_path):
    # Ensure the file path is a string
    if not isinstance(step_file_path, str):
        print("Invalid path:", step_file_path)
        return []

    # Ensure the file exists
    if not os.path.exists(step_file_path):
        print("File does not exist:", step_file_path)
        return []

    # Import step file
    rs.Command(f"_-Import \"{step_file_path}\" _Enter", False)

    # Delay
    time.sleep(2)  
    sc.doc.Views.Redraw()

    # RhinoCommon
    from Rhino.DocObjects import ObjectEnumeratorSettings

    settings = ObjectEnumeratorSettings()
    settings.IncludeLights = True
    settings.IncludeGrips = True
    settings.IncludeAnnotations = True
    settings.IncludeInstances = True
    settings.IncludeDetails = True
    settings.IncludeHatchPatterns = True
    settings.IncludeMeshes = True
    settings.IncludeCurves = True
    settings.IncludePoints = True
    settings.IncludeSurfaces = True
    settings.IncludeBrep = True  

    # Retrieve all objects
    imported_objects = list(Rhino.RhinoDoc.ActiveDoc.Objects.GetObjectList(settings))
    
    print(f"Found {len(imported_objects)} objects in the document.")

    # Delete objects
    for obj in imported_objects:
        # Rhino.RhinoDoc.ActiveDoc.Objects.Delete(obj, False)  

        return imported_objects


def get_breps_from_objects(object_list):
    if object_list is None:
        return []

    breps = []
    for obj in object_list:
        if isinstance(obj.Geometry, Rhino.Geometry.Brep):
            breps.append(obj.Geometry)
        else:
            print(f"Object ID {obj.Id} no Brep, is {type(obj.Geometry)}")
    return breps

def move_and_rename_file(step_file_path):
    main_directory = os.path.dirname(step_file_path)

    # Define the 'MODELS' folder 
    models_folder = os.path.join(main_directory, "MODELS")

    # Check if the 'MODELS' folder exists, if not, create
    if not os.path.exists(models_folder):
        os.makedirs(models_folder)
        print(f"Created folder: {models_folder}")

    # Count the number of existing files in 'MODELS'
    existing_files = [f for f in os.listdir(models_folder) if f.endswith('.step') or f.endswith('.stp')]
    model_number = len(existing_files) + 1

    # Date and time
    current_time = datetime.now().strftime("%Y-%m-%d_%H-%M")

    # New file name
    file_name = f"model-{model_number}_{current_time}.step"

    # Destination path
    destination_path = os.path.join(models_folder, file_name)

    # Move and rename
    shutil.move(step_file_path, destination_path)
    print(f"Moved and renamed file to: {destination_path}")

# Path tofile from input
step_file_path = output_file_path

# Import the file
imported_objects = import_step_file(step_file_path)

# Get Breps from imported objects
breps = get_breps_from_objects(imported_objects)
a = breps
# Output Breps
if breps:
    a = breps
    print(f"Output {len(breps)} Breps.")
else:
    a = "No Breps imported"
    print("No Breps were imported.")

# Move and rename
move_and_rename_file(step_file_path)
# ---------- end text_to_cad ----------
panel_3 = Panel(text_to_cad.output_file_path)
