# Grasshopper definition ZOOCAD_.gh (Grasshopper 1.0.8)
# Copyright: ©2019 GNU General Public License
# plug-ins: RhinoCodePluginGH, Human, Silkworm, Weaverbird

panel = Panel("sk-634DCZNUzA6IJ8KgcSOia5w1ylULijc2gfVKLHoXavT3BlbkFJ3DK0ZBfVaxBBXJ0B9-lMIBmhNvR3YdAq0lKqRYvfYA")
# PROMPT WRITING TIPS:
# 	•	Describe an object that can be represented in geometric shapes, not nebulous concepts such as "a tiger" or "the universe", unless you're just curious what it does with that 😏
# 	•	Be as explicit as possible. For example, if you want a plate with 4 holes, say where you want the holes placed and how big of a diameter each should have
# 	•	Our ML models are better at describing single objects than assemblies for now
panel_2 = Panel("bd6b055b-416b-442b-a6c3-82435c74c684")
file_path = FilePath("/Users/jorgemuyo/Desktop/Captura de pantalla 2024-08-31 a les 13.48.10.png")
image_to_prompt = Python3Script(x=panel)  # -> out, a
# ---------- image_to_prompt: Python ----------
from openai import OpenAI
import base64

# r: openai

def encode_image(image_path):
    with open(image_path, 'rb') as image_file:
        return base64.b64encode(image_file.read()).decode('utf-8')

api_key = x
image_path = y

client = OpenAI(api_key=api_key)

base64_image = encode_image(image_path)

response = client.chat.completions.create(
    model='gpt-4o-mini',
    messages=[
        {
            'role': 'user',
            'content': [
                {
                    'type': 'text',
                    'text': 'Describe an object that can be modeled in CAD with simple operations, being as explicit as possible, using meassures if possible and focusing on single, self-contained items rather than assemblies. Try to make descriptions as operations in a cad software. Try not to build super long prompts.'
                },
                {
                    'type': 'image_url',
                    'image_url': {
                        'url': f'data:image/png;base64,{base64_image}'
                    },
                }
            ],
        },
    ],
    max_tokens=300,
)

# print('Completion Tokens:', response.usage.completion_tokens)
# print('Prompt Tokens:', response.usage.prompt_tokens)
# print('Total Tokens:', response.usage.total_tokens)

a = response.choices[0].message.content
print(a)
# ---------- end image_to_prompt ----------
panel_3 = Panel(image_to_prompt.a)
panel_4 = Panel("Design a LEGO module")
file_path_2 = FilePath("/Users/jorgemuyo/Desktop/STUFF/AI_3D_Models_Grasshopper/")
text_to_cad = Python3Script(api=panel_2, path=file_path_2, prompt=panel_3, generate=Toggle(True))  # -> out, a, output_file_path; inputs generate: Boolean
# ---------- text_to_cad: Python ----------
import time
import os
import rhinoscriptsyntax as rs
import Rhino
import shutil
import scriptcontext as sc
from datetime import datetime

# r: kittycad

from kittycad.api.ai import create_text_to_cad, get_text_to_cad_model_for_user
from kittycad.client import Client
from kittycad.models.api_call_status import ApiCallStatus
from kittycad.models.file_export_format import FileExportFormat
from kittycad.models.text_to_cad_create_body import TextToCadCreateBody

# Set your API key directly in the code
API_KEY = api

# Create the client with the provided API key
client = Client(token=API_KEY)

# Define the output directory
output_dir = path

# Ensure the output directory exists
os.makedirs(output_dir, exist_ok=True)

# Set the variable 'a' to determine the output format
a = 2  # Change this value to 1, 2, or 3 to get .stl, .step, or .obj respectively

# Set the variable 'run_code' to control whether the script should run
run_code = generate  # Change this to False to skip running the script

if run_code:
    # Determine the output format based on the value of 'a'
    if a == 1:
        output_format = FileExportFormat.STL
        file_extension = "stl"
    elif a == 2:
        output_format = FileExportFormat.STEP
        file_extension = "step"
    elif a == 3:
        output_format = FileExportFormat.OBJ
        file_extension = "obj"
    else:
        raise ValueError("Invalid value for 'a'. Choose 1 for .stl, 2 for .step, or 3 for .obj.")

    # Prompt the API to generate a 3D model from text
    response = create_text_to_cad.sync(
        client=client,
        output_format=output_format,
        body=TextToCadCreateBody(
            prompt=prompt,
        ),
    )

    # Polling to check if the task is complete
    while response.completed_at is None:
        # Wait for 5 seconds before checking again
        time.sleep(5)

        # Check the status of the task
        response = get_text_to_cad_model_for_user.sync(
            client=client,
            id=response.id,
        )

    if response.status == ApiCallStatus.FAILED:
        # Print out the error message
        print(f"Text-to-CAD failed: {response.error}")

    elif response.status == ApiCallStatus.COMPLETED:
        # Print out the names of the generated files
        print(f"Text-to-CAD completed and returned {len(response.outputs)} files:")
        for name in response.outputs:
            print(f"  * {name}")

        # Save the data in the specified output directory
        final_result = response.outputs[f"source.{file_extension}"]
        output_file_path = os.path.join(output_dir, f"text-to-cad-output.{file_extension}")
        with open(output_file_path, "w", encoding="utf-8") as output_file:
            output_file.write(final_result.get_decoded().decode("utf-8"))
            print(f"Saved output to {output_file_path}")
else:
    print("Script execution is skipped as run_code is set to False.")


def import_step_file(step_file_path):
    """
    Import a STEP file into Rhino and return a list of object IDs.

    Parameters:
    step_file_path (str): The full path to the STEP file.

    Returns:
    list: A list of object IDs of the imported objects.
    """
    # Ensure the file path is a string
    if not isinstance(step_file_path, str):
        print("Invalid file path:", step_file_path)
        return []

    # Ensure the file exists
    if not os.path.exists(step_file_path):
        print("File does not exist:", step_file_path)
        return []

    # Import the STEP file
    rs.Command(f"_-Import \"{step_file_path}\" _Enter", False)

    # Add delay to ensure the import is complete
    time.sleep(2)  # Increased delay

    # Force a redraw to ensure objects are available
    sc.doc.Views.Redraw()

    # Get all objects in the document using RhinoCommon
    from Rhino.DocObjects import ObjectEnumeratorSettings

    settings = ObjectEnumeratorSettings()
    settings.IncludeLights = False
    settings.IncludeGrips = False
    settings.IncludeAnnotations = False
    settings.IncludeInstances = False
    settings.IncludeDetails = False
    settings.IncludeHatchPatterns = False
    settings.IncludeMeshes = False
    settings.IncludeCurves = False
    settings.IncludePoints = False
    settings.IncludeSurfaces = False
    settings.IncludeBrep = True  # Include Breps

    # Retrieve all objects
    imported_objects = list(Rhino.RhinoDoc.ActiveDoc.Objects.GetObjectList(settings))
    
    print(f"Found {len(imported_objects)} objects in the document.")

    # Delete the imported objects
    for obj in imported_objects:
        Rhino.RhinoDoc.ActiveDoc.Objects.Delete(obj, True)  # Delete the object and commit changes

    return imported_objects


def get_breps_from_objects(object_list):
    """
    Get Brep objects from Rhino objects.

    Parameters:
    object_list (list): A list of Rhino objects.

    Returns:
    list: A list of Brep objects.
    """
    if object_list is None:
        return []

    breps = []
    for obj in object_list:
        if isinstance(obj.Geometry, Rhino.Geometry.Brep):
            breps.append(obj.Geometry)
        else:
            print(f"Object ID {obj.Id} is not a Brep, it is {type(obj.Geometry)}")
    return breps

def move_and_rename_file(step_file_path):
    """
    Move the STEP file to the 'MODELS' folder and rename it.

    Parameters:
    step_file_path (str): The full path to the STEP file.
    """
    # Get the directory where the STEP file is located
    main_directory = os.path.dirname(step_file_path)

    # Define the 'MODELS' folder path
    models_folder = os.path.join(main_directory, "MODELS")

    # Check if the 'MODELS' folder exists, if not, create it
    if not os.path.exists(models_folder):
        os.makedirs(models_folder)
        print(f"Created folder: {models_folder}")

    # Count the number of existing STEP files in the 'MODELS' folder
    existing_files = [f for f in os.listdir(models_folder) if f.endswith('.step') or f.endswith('.stp')]
    model_number = len(existing_files) + 1

    # Get the current date and time
    current_time = datetime.now().strftime("%Y-%m-%d_%H-%M")

    # Create the new file name
    file_name = f"model-{model_number}_{current_time}.step"

    # Define the destination path
    destination_path = os.path.join(models_folder, file_name)

    # Move and rename the STEP file
    shutil.move(step_file_path, destination_path)
    print(f"Moved and renamed file to: {destination_path}")

# Path to the STEP file from input
step_file_path = output_file_path

# Import the STEP file
imported_objects = import_step_file(step_file_path)

# Get Breps from imported objects
breps = get_breps_from_objects(imported_objects)

# Output Breps to Grasshopper
if breps:
    a = breps
    print(f"Output {len(breps)} Breps.")
else:
    a = "No Breps imported"
    print("No Breps were imported.")

# Move and rename the STEP file
move_and_rename_file(step_file_path)
# ---------- end text_to_cad ----------
panel_5 = Panel(text_to_cad.output_file_path)
brep = Brep(text_to_cad.a)
number_slider = Slider(3, range=1..10)
crystallonv2_cell_selector = CrystallonV2CellSelector({"Prim. Cubic": 0, "BC": 1, "BC Cubic": 2, "FC Cubic": 3, "Edge Octa.": 4, "Vertex Octa.": 5, "NaCl": 6, "Star Tet.": 7, "BC Star Tet.": 8, "Octa. Tet.": 9, "Dodecahedron": 10, "Trunc. Octa.": 11, "Tetrahedral": 12, "Auxetic": 13, "BC1 (tween)": 14, "BC2 (tween)": 15, "Octa. (shell)": 16, "Dodeca. (shell)": 17, "Trunc. Octa. (shell)": 18, "Gyroid (shell)": 19, "Cubic Center (shell)": 20, "Cubic Face (shell)": 21, "LH Square": 22, "LH Round": 23, "LH Square (shell)": 24, "LH Auxetic (shell)": 25, "MC Tri": 26, "MS Tri (shell)": 27, "MC Quad": 28, "MS Quad (shell)": 29}, selected="Gyroid (shell)")
xy_plane = XYPlane(Origin=Point(0, 0, 0))
crystallonv2_cell_type = CrystallonV2CellType(unit_cell_selector=crystallonv2_cell_selector)
crystallonv2_voxelize_distance = CrystallonV2VoxelizeDistance(
    geometry=brep,
    plane=xy_plane,
    voxel_size_x=number_slider,
    voxel_size_y=number_slider,
    voxel_size_z=number_slider,
    fill_completely=Toggle(True))
crystallonv2_cell_shell_fill = CrystallonV2CellShellFill(unit_cell_shell=crystallonv2_cell_type, voxels=crystallonv2_voxelize_distance, tolerance="0.01")
crystallonv2_trim_shell = CrystallonV2TrimShell(geometry=brep, lattice_shell=crystallonv2_cell_shell_fill)
weaverbird_s_mesh_thicken = WeaverbirdsMeshThicken(MeshCurves=crystallonv2_trim_shell, Distance=Slider(0.15, range=0..1), OffsetType=0)
data_dam = DataDam(DataDataA=weaverbird_s_mesh_thicken, BufferDelay=10000000, BufferMode=0)
weaverbird_s_catmull_clark_subdivision = WeaverbirdsCatmullClarkSubdivision(MeshCurves=data_dam, Level=Slider(2, range=0..10), SmoothNakedEdges=1)
mesh = Mesh(brep)
flatten_tree = FlattenTree(Tree=[weaverbird_s_catmull_clark_subdivision, mesh], Path="{0}")
mesh_join = MeshJoin(Meshes=flatten_tree)
bounding_box = BoundingBox(Content=mesh_join, Plane=PlaneXY(0, 0, 0))  # -> Box, Box_2
box_corners = BoxCorners(Box=bounding_box.Box)  # -> CornerA, CornerB, CornerC, CornerD, CornerE, CornerF, CornerG, CornerH
line = Line(StartPoint=box_corners.CornerA, EndPoint=box_corners.CornerE)
divide_length = DivideLength(Curve=line, Length=Slider(0.4, range=0..1))  # -> Points, Tangents, Parameters
xy_plane_2 = XYPlane(Origin=divide_length.Points)
mesh_plane = MeshPlane(Mesh=mesh_join, Plane=xy_plane_2)
explode = Explode(Curve=mesh_plane, Recursive=True)  # -> Segments, Vertices
flatten_tree_2 = FlattenTree(Tree=explode.Vertices, Path="{0}")
nurbs_curve = NurbsCurve(Vertices=flatten_tree_2, Degree=3, Periodic=False)  # -> Curve, Length, Domain
create_material = CreateMaterial(
    Diffuse=RGB(255, 131, 193),
    Specular=RGB(255, 254, 255),
    Emission=ColourSwatch(SwatchColor=RGB(255, 254, 255)),
    Transparency=0,
    Shine=0)
custom_preview_lineweights = CustomPreviewLineweights(
    Geometry=nurbs_curve.Curve,
    Shader=ColourSwatch(SwatchColor=RGB(255, 255, 255)),
    Thickness=Slider(1, range=0..1),
    Absolute=False)
custom_preview = CustomPreview(
    Geometry=brep,
    Material={diffuse=RGB(255, 0, 255), emission=RGB(0, 0, 0), shine=0.85, specular=RGB(217, 217, 217), transparency=0})
divide_length_2 = DivideLength(Curve=nurbs_curve.Curve, Length=Slider(1, range=0..1))  # -> Points, Tangents, Parameters
number_slider_2 = Slider(3, range=0..10)
polyline = PolyLine(Vertices=divide_length_2.Points, Closed=False)
flow = Flow(NozzleWidth=number_slider_2, LayerHeight="0.893", FilamentDiameter=number_slider_2, Multiplier=1)
explode_2 = Explode(Curve=polyline, Recursive=True)  # -> Segments, Vertices
multiplication = Multiplication(A=Slider(15, range=0..100), B=Slider(60, range=0..100))
silkworm_extrusion_path = SilkwormExtrusionPath(MovementLines=explode_2.Segments, SpeedParameter=multiplication, FlowRatio=flow)
silkworm_compiler = SilkwormCompiler(SilkwormMovements=flatten(silkworm_extrusion_path))  # -> GCode, SilkwormModel
panel_6 = Panel(silkworm_compiler.GCode)

# ==== cluster CrystallonV2VoxelizeDistance: Fill a volume with equal sized voxels

voxel_size_x = ClusterInput()  # Voxel size int the X direction
voxel_size_y = ClusterInput()  # Voxel size int the Y direction
voxel_size_z = ClusterInput()  # Voxel size int the Z direction
plane = ClusterInput()  # Base plane for voxels
geometry = ClusterInput()  # Geometry to voxelize
fill_completely = ClusterInput()  # If true, Voxels will fill entire volume. If false, only Voxels with their centroid within the volume will be kept.
mesh = Mesh(geometry)
pln = Plane(plane)
num = Number(voxel_size_x)
num_2 = Number(voxel_size_y)
num_3 = Number(voxel_size_z)
bool = Boolean(fill_completely)
bbox = BoundingBox(Content=mesh, Plane=pln)  # -> Box, Box_2
edges = BrepEdges(Brep=bbox.Box)  # -> Naked, Interior, NonManifold
item = ListItem(List=edges.Interior, Index="8", Wrap=True)
item_2 = ListItem(List=edges.Interior, Index="1", Wrap=True)
# CRYSTALLON V2.0 -- Lattice structure tools for Grasshopper3D
# 
# Copyright (C) 2019  Aaron Porterfield
# 
# www.fequalsf.com
# info@fequalsf.com
# 
#     This program is free software: you can redistribute it and/or modify
#     it under the terms of the GNU General Public License as published by
#     the Free Software Foundation, either version 3 of the License, or any later version.
# 
#     This program is distributed in the hope that it will be useful,
#     but WITHOUT ANY WARRANTY; without even the implied warranty of
#     MERCHANTABILITY or FITNESS FOR A PARTICULAR PURPOSE.  See the
#     GNU General Public License for more details.
# 
#     You should have received a copy of the GNU General Public License
#     along with this program.  If not, see <http://www.gnu.org/licenses/>.
item_3 = ListItem(List=edges.Interior, Index="0", Wrap=True)
divlength = DivideLength(Curve=reparameterize(item_2), Length=num_2)  # -> Points, Tangents, Parameters
divlength_2 = DivideLength(Curve=reparameterize(item_3), Length=num)  # -> Points, Tangents, Parameters
divlength_3 = DivideLength(Curve=reparameterize(item), Length=num_3)  # -> Points, Tangents, Parameters
reldif = RelativeDifferences(Values=divlength.Parameters)
reldif_2 = RelativeDifferences(Values=divlength_2.Parameters)
reldif_3 = RelativeDifferences(Values=divlength_3.Parameters)
item_4 = ListItem(List=reverse(divlength.Parameters), Index=0, Wrap=True)
item_5 = ListItem(List=reverse(reldif), Index=0, Wrap=True)
item_6 = ListItem(List=reverse(divlength_2.Parameters), Index=0, Wrap=True)
item_7 = ListItem(List=reverse(reldif_2), Index=0, Wrap=True)
item_8 = ListItem(List=reverse(divlength_3.Parameters), Index=0, Wrap=True)
item_9 = ListItem(List=reverse(reldif_3), Index=0, Wrap=True)
addition = Addition(A=item_5, B=item_4)
addition_2 = Addition(A=item_7, B=item_6)
addition_3 = Addition(A=item_9, B=item_8)
merge = Merge(Data1=divlength.Parameters, Data2=addition)
merge_2 = Merge(Data1=divlength_2.Parameters, Data2=addition_2)
merge_3 = Merge(Data1=divlength_3.Parameters, Data2=addition_3)
crossref = CrossReference(ListA=merge, ListB=merge_3, CrossMode=1)  # -> ListA, ListB
box = EvaluateBox(Box=bbox.Box, UParameter=graft(merge_2), VParameter=crossref.ListA, WParameter=crossref.ListB)  # -> Plane, Point, Include
panel = Panel("Voxelize")
division = Division(A=num_3, B="2")
division_2 = Division(A=num_2, B="2")
division_3 = Division(A=num, B="2")
neg = Negative(Value=division)
neg_2 = Negative(Value=division_2)
neg_3 = Negative(Value=division_3)
dom = ConstructDomain(DomainStart=neg, DomainEnd=division)
dom_2 = ConstructDomain(DomainStart=neg_2, DomainEnd=division_2)
dom_3 = ConstructDomain(DomainStart=neg_3, DomainEnd=division_3)
crossref_2 = CrossReference(ListA=dom_2, ListB=dom, CrossMode=1)  # -> ListA, ListB
box_2 = DomainBox(Base=simplify(box.Plane), X=graft(dom_3), Y=crossref_2.ListA, Z=crossref_2.ListB)
minc = MeshInclusion(Mesh=mesh, Point=box.Plane, Strict=False)
sort = SortList(Keys=[num, num_2, num_3])  # -> Keys, ValuesA
cull = CullPattern(List=box_2, CullPattern=minc)
meshcp = MeshClosestPoint(Point=box.Plane, Mesh=mesh)  # -> Point, Index, Parameter
dist = Distance(PointA=box.Plane, PointB=meshcp.Point)
expression = Expression(a=sort.Keys, d=dist, Expression="if(d<sqrt(2*(a/2)^2),True,False)")
cull_2 = CullPattern(List=box_2, CullPattern=expression)
cull_3 = CullPattern(List=cull_2, CullPattern=bool)
merge_4 = Merge(Data1=cull, Data2=cull_3)
voxels = ClusterOutput(merge_4)  # Voxels to be filled with unit cells

# ==== cluster CrystallonV2CellType: A collection of pre-made unit cells

crv = Curve([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])
crv_2 = Curve([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])
crv_3 = Curve([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])
crv_4 = Curve([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])
crv_5 = Curve([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])
mesh = Mesh(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)
mesh_2 = Mesh(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)
mesh_3 = Mesh(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)
mesh_4 = Mesh([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])
crv_6 = Curve([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])
crv_7 = Curve([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])
crv_8 = Curve([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])
crv_9 = Curve([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])
crv_10 = Curve([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])
crv_11 = Curve([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])
crv_12 = Curve([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])
crv_13 = Curve([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])
crv_14 = Curve([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])
crv_15 = Curve([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])
crv_16 = Curve([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])
mesh_5 = Mesh(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)
mesh_6 = Mesh(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)
mesh_7 = Mesh(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)
mesh_8 = Mesh(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)
crv_17 = Curve([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])
crv_18 = Curve([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])
mesh_9 = Mesh(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)
geo = Geometry([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])
geo_2 = Geometry([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])
mesh_10 = Mesh([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])
panel = Panel("CELL TYPES")
entwine = Entwine(
    Branch00=crv_6,
    Branch01=crv_7,
    Branch02=crv,
    Branch03=crv_8,
    Branch04=crv_2,
    Branch05=crv_9,
    Branch06=crv_3,
    Branch07=crv_10,
    Branch08=crv_11,
    Branch09=crv_12,
    Branch010=crv_4,
    Branch011=crv_5,
    Branch012=crv_13,
    Branch013=crv_14,
    Branch014=crv_15,
    Branch015=crv_16,
    Branch016=mesh,
    Branch017=mesh_5,
    Branch018=mesh_6,
    Branch019=mesh_2,
    Branch020=mesh_7,
    Branch021=mesh_8,
    Branch022=crv_17,
    Branch023=crv_18,
    Branch024=mesh_9,
    Branch025=mesh_3,
    Branch026=geo,
    Branch027=mesh_4,
    Branch028=geo_2,
    Branch029=mesh_10,
    FlattenInputs=True)  # -> simplify(Result)
unit_cell_selector = ClusterInput()
branch = TreeBranch(Tree=entwine, Path=unit_cell_selector, MaintainPaths=True)
unit_cell = ClusterOutput(branch)  # Single unit cell to populate voxels

# ==== cluster CrystallonV2CellShellFill: Fill voxels with shell unit cells

unit_cell_shell = ClusterInput()  # Unit cell to populate voxels
tolerance = ClusterInput()  # Tolerance for merging faces and vertices (number usually between 0.001 and 0.1)
voxels = ClusterInput()  # Voxels to be filled with unit cells
geo = Geometry(unit_cell_shell)
bbox = BoundingBox(Content=geo, Plane=PlaneXY(0, 0, 0), UnionBox=True)  # -> Box, Box_2
morph = BoxMorph(Geometry=geo, Reference=bbox.Box, Target=graft(voxels))  # -> flatten(Geometry)
mjoin = MeshJoin(Meshes=morph)
panel = Panel("CELL SHELL FILL")
demesh = DeconstructMesh(Mesh=mjoin)  # -> Vertices, Faces, Colours, Normals
facen = FaceNormals(Mesh=mjoin)  # -> Centers, Normals
cullpt = CullDuplicates(Points=facen.Centers, Tolerance=tolerance, CullMode=1)  # -> Points, Indices, Valence
item = ListItem(List=demesh.Faces, Index=cullpt.Indices, Wrap=True)
conmesh = ConstructMesh(Vertices=demesh.Vertices, Faces=item)
weld = WeldMesh(Mesh=conmesh, Angle=3.141592654)
c_script = CSharpScript(M=weld, radius=tolerance)  # -> out, A; inputs M: Mesh, radius: Double
# ---------- c_script: C# usings ----------
using System.IO;
using System.Linq;
using System.Data;
using System.Drawing;
using System.Reflection;
using System.Windows.Forms;
using System.Xml;
using System.Xml.Linq;
using System.Runtime.InteropServices;

using Rhino.DocObjects;
using Rhino.Collections;
using GH_IO;
using GH_IO.Serialization;
# ---------- c_script: C# ----------
    Component.Message = "Weld Mesh - RTree";


    //Store naked mesh vertices and their ids
    List<Point3f> pts = new List<Point3f>();
    bool[] flag = M.GetNakedEdgePointStatus();

    allPointsFound = new List<List<int>>();

    //History is need to stop searching rtee
    //When all point groups are found
    history.Clear();

    //Create Rtree
    RTree tree = new RTree();

    for(int i = 0; i < flag.Length; i++){
      if(flag[i]){
        tree.Insert(M.Vertices[i], i);
        pts.Add(M.Vertices[i]);
      }
    }

    //Search RTree
    for(int i = 0; i < pts.Count; i++){
      tempIDList = new List<int>();
      tree.Search(new Sphere(pts[i], radius), method);

      if(tempIDList.Count > 1)
        allPointsFound.Add(tempIDList);

      if(history.Count == M.Vertices.Count)
        break;
    }

    //Now move found vertices to one of firs vertex position
    foreach(List<int> i in allPointsFound)
      for(int j = 1; j < i.Count; j++)
        M.Vertices[i[0]] = M.Vertices[i[j]];

    M.Vertices.CombineIdentical(true, true);


    A = M;
# ---------- c_script: C# additional code ----------
  //Rtree collections
  List<int> history = new List<int>();
  List<List<int>> allPointsFound;
  List<int> tempIDList;

  private void method(object sender, RTreeEventArgs e){
    if(!history.Contains(e.Id)){
      tempIDList.Add(e.Id);
      history.Add(e.Id);
    }
  }
# ---------- end c_script ----------
lattice_shell = ClusterOutput(c_script.A)  # Joined mesh that makes up the lattice

# ==== cluster CrystallonV2TrimShell: Trim shell lattice with a closed volume

lattice_shell = ClusterInput()  # Lattice shell to trim
geometry = ClusterInput()  # Geometry to trim with (closed brep or mesh)
geo = Geometry(geometry)
mjoin = MeshJoin(Meshes=flatten(lattice_shell))
mesh = Mesh(geo)
weld = WeldMesh(Mesh=mjoin, Angle=3.141592654)
panel = Panel("TRIM SHELL")
demesh = DeconstructMesh(Mesh=weld)  # -> Vertices, Faces, Colours, Normals
minc = MeshInclusion(Mesh=mesh, Point=demesh.Vertices, Strict=False)
not = GateNot(A=minc)
cullv = CullVertices(Mesh=weld, Pattern=not, Shrink=True)
trimmed_lattice_shell = ClusterOutput(cullv)  # Trimmed lattice shell
