# Grasshopper definition components_used.gh (Grasshopper 1.0.8)
# plug-ins: AI_Tools.Components

file_path = FilePath("/Users/jorgemuyo/Desktop/GH_AI_3D/IMGS/DOCUMENTATION/test.png")
image_to_prompt = ImageToPrompt(X="you-api-key", Y=file_path)
panel = Panel(image_to_prompt)
file_path_2 = FilePath("/Users/jorgemuyo/Desktop/")
text_to_cad = TextToCAD(APIKey="your-api-key", Directory=file_path_2, Prompt=panel, Activate=Toggle(False))  # -> AIModel, Output_file_path
