# Grasshopper definition Image_to_CAD.gh (Grasshopper 1.0.8)
# plug-ins: AI_Tools Info

panel = Panel("sk-634DCZNUzA6IJ8KgcSOia5w1ylULijc2gfVKLHoXavT3BlbkFJ3DK0ZBfVaxBBXJ0B9-lMIBmhNvR3YdAq0lKqRYvfYA")
file_path = FilePath("/Users/jorgemuyo/Desktop/AI_Tools/IMGS/AI_TOOLS.jpg")
image_to_prompt = ImageToPrompt(Generate=Toggle(False), APIKey=panel, ImagePath=file_path, Model="gpt-4o-mini", MaxTokens=300, Timeout=60000)  # -> Prompt, Success
panel_2 = Panel(image_to_prompt.Success)
panel_3 = Panel("""### CAD Modeling Instructions for a LEGO-like Brick

#### Step 1: Base Rectangle
1. **Create a New Sketch** on the XY plane.
2. **Draw a Rectangle**:
   - **Length**: 30 mm
   - **Width**: 12 mm
3. **Extrude the Rectangle**:
   - **Height**: 9.6 mm

#### Step 2: Create the Studs
4. **New Sketch** on the top surface of the rectangle.
5. **Draw Circles** for studs:
   - **Diameter**: 4.8 mm
   - **Position**: Place circles at coordinates:
     - (5 mm, 2 mm)
     - (5 mm, 10 mm)
     - (15 mm, 2 mm)
     - (15 mm, 10 mm)
     - (25 mm, 2 mm)
     - (25 mm, 10 mm)
6. **Extrude the Circles**:
   - **Height**: 1.8 mm

#### Step 3: Add the Recesses for Studs
7. **New Sketch** on the top surface of the rectangle.
8. **Draw Circles** for the recesses:
   - **Diameter**: 3.2 mm
   - **Position**: Centered on the previously drawn studs.
9. **Extrude Cut the Circles**:
   - **Cut""")
panel_4 = Panel(image_to_prompt.Prompt)
file_path_2 = FilePath("/Users/jorgemuyo/Desktop/")
text_to_cad = TextToCAD(
    Generate=Toggle(False),
    APIKey="api-9df6f35f-22ff-418d-981e-291b2274219f",
    Prompt=panel_3,
    OutputDirectory=file_path_2,
    Format=2)  # -> Breps, FilePath, Success, Status
panel_5 = Panel(text_to_cad.Status)
panel_6 = Panel(text_to_cad.Success)
